# Dynamo graph Create_Legend_DoorSchedule_script.dyn (Dynamo 2.6.1.8786)
# packages: spring nodes 204.1.0

# group: Selecting legend and generic annotations
# note: README
# 1.springs package needed for current selection in revit
# 2. Scale determines the size of box
# 3. only one generic annotation and legend at a time
ꟿ_collect_currentselection = Custom[ꟿ Collect.CurrentSelection]()  # package spring nodes; Gets the currently selected elements. Connect a boolean switch to refresh the selection.
getCategory = Element.GetCategory(element=ꟿ_collect_currentselection)
watch = Watch(getCategory)
string_from_object = FromObject(obj=watch)
string = StringInput("Generic Annotations")
boolean = BoolSelector(false)
contains = String.Contains(str=string_from_object, searchFor=string, ignoreCase=boolean)
filterByBoolMask = List.FilterByBoolMask(list=ꟿ_collect_currentselection, mask=contains)

# group: Extract Parameter Values
watch_2 = Watch(filterByBoolMask.out)
code_block = CodeBlock { "Component Type"; }
parameterByName = Parameter.ParameterByName(element=filterByBoolMask.out, name=code_block, lacing=Shortest)
string_from_object_2 = FromObject(obj=parameterByName)
code_block_2 = CodeBlock { ": "; }
split = String.Split(str=string_from_object_2, separator0=code_block_2, lacing=Shortest)
code_block_3 = CodeBlock { "GCU"; }
boolean_2 = BoolSelector(true)
contains_2 = String.Contains(str=split@L2, searchFor=code_block_3, ignoreCase=boolean_2)
filterByBoolMask_2 = List.FilterByBoolMask(list=split, mask=contains_2)
watch_3 = Watch(filterByBoolMask_2.in)

watch_4 = Watch(filterByBoolMask.in)
lastItem = List.LastItem(list=split@L2)

# group: Input Values into family
watch_5 = Watch(watch_4)
code_block_4 = CodeBlock { "Door Type Mark"; "Door Width"; "Door Height"; "Door Description"; }
byName = FamilyType.ByName(name=lastItem, lacing=Shortest)
code_block_5 = CodeBlock { "Type Mark"; "Width"; "Height"; "Description"; }
getParameterValueByName = Element.GetParameterValueByName(element=byName, parameterName=code_block_5.out0)
string_from_object_3 = FromObject(obj=getParameterValueByName)
setParameterByName = Element.SetParameterByName(element=watch_5, parameterName=code_block_4.out0, value=string_from_object_3, lacing=Shortest)
getParameterValueByName_2 = Element.GetParameterValueByName(element=byName, parameterName=code_block_5.out1)
string_from_object_4 = FromObject(obj=getParameterValueByName_2)
code_block_6 = CodeBlock { "."; }
split_2 = String.Split(str=string_from_object_4, separator0=code_block_6)
setParameterByName_2 = Element.SetParameterByName(element=watch_5, parameterName=code_block_4.out1, value=split_2, lacing=Shortest)
getParameterValueByName_3 = Element.GetParameterValueByName(element=byName, parameterName=code_block_5.out2)
string_from_object_5 = FromObject(obj=getParameterValueByName_3)
code_block_7 = CodeBlock { "."; }
split_3 = String.Split(str=string_from_object_5, separator0=code_block_7)
setParameterByName_3 = Element.SetParameterByName(element=watch_5, parameterName=code_block_4.out2, value=split_3, lacing=Shortest)
getParameterValueByName_4 = Element.GetParameterValueByName(element=byName, parameterName=code_block_5.out3)
string_from_object_6 = FromObject(obj=getParameterValueByName_4)
setParameterByName_4 = Element.SetParameterByName(element=watch_5, parameterName=code_block_4.out3, value=string_from_object_6, lacing=Shortest)

# group: Edit Box Width and Height
# note: Divided by 50 because this legend is in 1:50 scale
code_block_8 = CodeBlock { "Table Width"; }
scale = CodeBlock { 50; }
code_block_9 = CodeBlock(x=getParameterValueByName_2, scale=scale) { (x/scale)+25; }
desired_box_width = CodeBlock { 4500; }
code_block_10 = CodeBlock(x=desired_box_width, scale=scale) { x/scale; }
gt = code_block_9 > code_block_10
if_ = If(test=gt, true=code_block_9, false=code_block_10)
setParameterByName_5 = Element.SetParameterByName(element=watch_4, parameterName=code_block_8, value=if_, lacing=Shortest)
code_block_11 = CodeBlock { "Table Height (Door Elevation)"; }
code_block_12 = CodeBlock(x=getParameterValueByName_3, scale=scale) { (x/scale)+25; }
desired_box_height = CodeBlock { 4500; }
code_block_13 = CodeBlock(x=desired_box_height, scale=scale) { x/scale; }
gt_2 = code_block_12 > code_block_13
if_2 = If(test=gt_2, true=code_block_12, false=code_block_13)
setParameterByName_6 = Element.SetParameterByName(element=watch_4, parameterName=code_block_11, value=if_2, lacing=Shortest)
